vi "index.gviweb"   [G Web Development Software 21.0.0]
panel controls:
  "Tab": i32
  "Tab Selector Visible": bool = TRUE
uses:
  ControlExtensions::Tab - Selector - Visible.gvi
diagram:
  while {
    event {
      on "Tab Selector Visible" Value changed {
        Event Data() -> ("New Value"=w1)
        call "Tab - Selector - Visible.gvi"(reference in=reference to "Tab", visible=w1)
      }
    }
    stop if FALSE
  }
