vi "index.gviweb"   [LabVIEW NXG 3.1.0]
panel indicators:
  "name": string[]
  "value": string[]
  "found": bool[]
  "name_2": string[]
  "value_2": string[]
  "found_2": bool[]
uses:
  DOM::Search::Query Selector.gvi
  DOM::Build::Create Document Fragment.gvi
  DOM::Operate::Attributes::Set Attributes Options Append.gvi
  DOM::Operate::Attributes::Set Attributes.gvi
  DOM::Build::Append Child.gvi
  DOM::Operate::Attributes::Get Attributes.gvi
diagram:
  call "Query Selector.gvi"(selector=".placeholder") -> (element reference=w1)
  # Top-Level WebVIs usually contain a While Loop that never stops so that they can continue running as long as the web page is open in the user's web browser.
  while (after w1) {
    Wait(time to wait=50)
    stop if FALSE
  }
  call "Create Document Fragment.gvi"(fragment content="<iframe random=\"lol\"></iframe>", selectors=["iframe"]) -> (element references=w2)
  Array Index(array=w2) -> (out0[_]=w3)
  call "Set Attributes Options Append.gvi"(name="src", value="http://www.ni.com") -> (set attributes options out=w4)
  call "Set Attributes.gvi"(dom reference in=w3, attribute set options=w4) -> (dom reference out=w5)
  call "Append Child.gvi"(parent reference=w1, child reference=w5, clear parent content=TRUE)
  call "Get Attributes.gvi"(element reference=w5) -> (name=w6, value=w7, found=w8)
  $name <- w6
  $value <- w7
  $found <- w8
  call "Get Attributes.gvi"(element reference=w5, names=["random", "fakenews"]) -> (name=w9, value=w10, found=w11)
  $name_2 <- w9
  $value_2 <- w10
  $found_2 <- w11
