vi "index.gviweb"   [LabVIEW NXG 4.0.0]
panel indicators:
  "code": string
  "key": string
  "error out": error
  "Keyboard event on specific elements": string
  "code specific element": string
  "key specific element": string
  "error out specific element": error
uses:
  EventTarget::Keyboard::Add Keyboard Event Listener - Window.gvi
  EventTarget::Keyboard::Wait For Keyboard Event.gvi
  EventTarget::Shared::Remove Event Listener.gvi
  EventTarget::Keyboard::Add Keyboard Event Listener - Element.gvi
diagram:
  call "Add Keyboard Event Listener - Window.gvi"(keyboard event type="keydown") -> (event manager reference=w1, error out=w2)
  s1 = w2  # shift register
  while {
    call "Wait For Keyboard Event.gvi"(event manager reference in=w1, error in=s1) -> (event manager reference out=w3, code=w4, key=w5, error out=w6)
    $code <- w4
    $key <- w5
    next s1 = w6
    stop if w6
  }
  call "Remove Event Listener.gvi"(event manager reference=w3, error in=s1) -> (error out=w7)
  $"error out" <- w7
  call "Add Keyboard Event Listener - Element.gvi"(selector=".my-element", keyboard event type="keydown") -> (event manager reference=w8, error out=w9)
  s2 = w9  # shift register
  while {
    call "Wait For Keyboard Event.gvi"(event manager reference in=w8, error in=s2) -> (event manager reference out=w10, code=w11, key=w12, error out=w13)
    $"code specific element" <- w11
    $"key specific element" <- w12
    next s2 = w13
    stop if w13
  }
  call "Remove Event Listener.gvi"(event manager reference=w10, error in=s2) -> (error out=w14)
  $"error out specific element" <- w14
