vi "index.gviweb"   [LabVIEW NXG 3.1.0]
panel controls:
  "Button": bool
panel indicators:
  "error out": error
  "data uri for png image": string
uses:
  Uppy::Uppy.jsli::Get User File
  Uppy::Uppy.jsli::Base64 Encode Byte Array
diagram:
  while {
    event {
      on "Button" Value changed {
        call "Get User File"() -> (file contents=w2, error out=w3)
        call "Base64 Encode Byte Array"(buffer=w2, error in=w3) -> (encoded string=w4, error out=w1)
        Concatenate Strings("data:image/png;base64,", w4) -> w5
        $"data uri for png image" <- w5
      }
    }
    stop if w1
  }
  $"error out" <- w1
