vi "index.gviweb"   [LabVIEW NXG 4.0.0]
panel controls:
  "Button": bool
panel indicators:
  "time": f32[]
  "Error Output": error
  "frequency": f32[]
uses:
  WebAudio::Create Media Stream Audio Source Node.gvi
  WebAudio::Create Analyzer.gvi
  WebAudio::Get Analyser Frequency Data.gvi
  WebAudio::Get Analyser Time Domain Data.gvi
diagram:
  sequence {
    frame 0 {
      while {
        Wait(time to wait=500)
        stop if $Button
      }
    }
    frame 1 {
      call "Create Media Stream Audio Source Node.gvi"() -> (audio node reference=w1, error out=w2)
      call "Create Analyzer.gvi"(audio node reference=w1, error in=w2) -> (analyser reference=w3, error out=w4)
    }
  }
  s1 = w4  # shift register
  while {
    Wait(time to wait=10)
    call "Get Analyser Frequency Data.gvi"(analyser reference=w3, error in=s1) -> (frequency data=w5, error out=w6)
    $frequency <- w5
    call "Get Analyser Time Domain Data.gvi"(analyser reference=w3, error in=w6) -> (time domain data=w7, error out=w8)
    $time <- w7
    next s1 = w8
    stop if w8
  }
  $"Error Output" <- s1
