vi "BatteryLevel.gviweb"   [LabVIEW NXG 3.1.0]
panel controls:
  "connect to battery": bool
panel indicators:
  "Output": error
  "value": u8[]
  "id": string
  "name": string
uses:
  WebBluetooth::UUID::Service UUID (String).gvi
  WebBluetooth::Filter::Set Filter Services.gvi
  WebBluetooth::Request Device.gvi
  WebBluetooth::WebBluetooth.jsli::GATT Server Connect
  WebBluetooth::WebBluetooth.jsli::Get Primary Service
  WebBluetooth::WebBluetooth.jsli::Get Characteristic
  WebBluetooth::WebBluetooth.jsli::Read Value
diagram:
  while {
    event {
      on "connect to battery" Value changed {
        call "Service UUID (String).gvi"(name="battery_service") -> (uuid=w2)
        Build Array(w2) -> w3
        call "Set Filter Services.gvi"(service uuids=w3) -> (filter out=w4)
        Build Array(w4) -> w5
        call "Request Device.gvi"(filters=w5) -> (id=w6, name=w7, error out=w1)
        $id <- w6
        $name <- w7
      }
    }
    stop if w1
  }
  Property Node(instance in=w1) -> ("source"=w8)
  One Button Dialog(message=w8)
  disable {
    frame Enabled { }
    frame Disabled {
      call "GATT Server Connect"() -> (gatt server refnum=w9, error out=w10)
      call "Get Primary Service"(gatt server refnum=w9, service="battery_service", error in=w10) -> (service refnum=w11, error out=w12)
      call "Get Characteristic"(service refnum=w11, characteristic="battery_level", error in=w12) -> (characteristic refnum=w13, error out=w14)
      call "Read Value"(charcteristic refnum=w13, error in=w14) -> (value=w15, error out=w16)
      $value <- w15
      $Output <- w16
    }
  }
