vi "index.gviweb"   [G Web Development Software 22.3.0]
panel indicators:
  "String": string
uses:
  WebVIDeno::Support::WebVIDeno.jsli::Log
  NI::G Core::Operating System::Write to System Log.gvi
  NI::WebSockets::Open WebSocket.gvi
  NI::WebSockets::Write String.gvi
  NI::WebSockets::Read String.gvi
  NI::WebSockets::Close WebSocket.gvi
diagram:
  $String <- "hello world!"
  call "Log"()
  call "Write to System Log.gvi"(message="hello world!") -> (error out=w1)
  Concatenate Strings("Opening websocket echo server connection to: ", "wss://ws.ifelse.io/") -> w2
  call "Write to System Log.gvi"(message=w2, error in=w1) -> (error out=w3)
  call "Open WebSocket.gvi"(url="wss://ws.ifelse.io/", error in=w3) -> (websocket session out=w4, error out=w5)
  call "Write String.gvi"(websocket session in=w4, string message="Echooo", error in=w5) -> (websocket session out=w6, error out=w7)
  call "Read String.gvi"(websocket session in=w6, timeout=3, error in=w7) -> (websocket session out=w8, string response=w9, error out=w10)
  call "Close WebSocket.gvi"(websocket session in=w8, error in=w10) -> (error out=w11)
  call "Write to System Log.gvi"(message=w9, error in=w11) -> (error out=w12)
  call "Write to System Log.gvi"(message="Finished WebSocket connection.", error in=w12)
